# Grasshopper definition kgr2PointBoxCollision.gh (Grasshopper 1.0.8)
# plug-ins: Kangaroo2 Components

point = Point("10,10,10")
point_2 = Point("0,0,0")
box_2pt = Box2Pt(PointA=point_2, PointB=point, Plane=PlaneXY(0, 0, 0))
point_3 = Point("-1,-1,0")
point_4 = Point("11,11,0")
unit_z = UnitZ(Factor=1)
rectangle_2pt = Rectangle2Pt(Plane=PlaneXY(0, 0, 0), PointA=point_3, PointB=point_4, Radius=0)  # -> Rectangle, Length
populate_3d = Populate3D(Region=box_2pt, Count=100, Seed=1)
boolean_toggle = BooleanToggle(False)
multiplication = Multiplication(A=unit_z, B="-0.0000001")
box_rectangle = BoxRectangle(Rectangle=rectangle_2pt.Rectangle, Height="-1")
gate_not = GateNot(A=boolean_toggle)
load = Load(Point=populate_3d, ForceVector=multiplication, Weighting=1)
solidpointcollide = SolidPointCollide(Points=populate_3d, Solid=box_rectangle, Interior=False, Unidirectional=True, Strength=1)
solver = Solver(GoalObjects=[load, solidpointcollide], Reset=gate_not, Threshold=1e-15, Tolerance=0.0001, On=boolean_toggle)  # -> I, V, O
panel = Panel(solver.V)
