# Grasshopper definition kgr2SpringAnchorConstraint.gh (Grasshopper 1.0.8)
# plug-ins: Kangaroo2 Components

md_slider = MDSlider(SliderMode=0, slider_value=Point(1, 1, 0.5), x_domain=Domain(0, 10), y_domain=Domain(0, 10), z_domain=Domain(0, 1))
md_slider_2 = MDSlider(SliderMode=0, slider_value=Point(0, 0, 0.5), x_domain=Domain(0, 1), y_domain=Domain(0, 1), z_domain=Domain(0, 1))
number_slider = Slider(10, range=0..20)
rectangle_2pt = Rectangle2Pt(Plane=PlaneXY(0, 0, 0), PointA=md_slider_2, PointB=md_slider, Radius=0)  # -> Rectangle, Length
digit_scroller = DigitScroller(Scroller_Digits=12, Scroller_Prefix="Digit Scroller", Scroller_Radix=9, Scroller_Value=-1)
mesh_plane = MeshPlane(Boundary=rectangle_2pt.Rectangle, WidthCount=number_slider, HeightCount=number_slider)  # -> Mesh, Area
digit_scroller_2 = DigitScroller(Scroller_Digits=12, Scroller_Prefix="Digit Scroller", Scroller_Radix=9, Scroller_Value=0)
digit_scroller_3 = DigitScroller(Scroller_Digits=12, Scroller_Prefix="Digit Scroller", Scroller_Radix=9, Scroller_Value=10)
digit_scroller_4 = DigitScroller(Scroller_Digits=12, Scroller_Prefix="Digit Scroller", Scroller_Radix=9, Scroller_Value=110)
digit_scroller_5 = DigitScroller(Scroller_Digits=12, Scroller_Prefix="Digit Scroller", Scroller_Radix=9, Scroller_Value=120)
digit_scroller_6 = DigitScroller(Scroller_Digits=12, Scroller_Prefix="Digit Scroller", Scroller_Radix=9, Scroller_Value=10)
deconstruct_mesh = DeconstructMesh(Mesh=mesh_plane.Mesh)  # -> Vertices, Faces, Colours, Normals
unit_z = UnitZ(Factor=digit_scroller)
edgelengths = EdgeLengths(Mesh=mesh_plane.Mesh, LengthFactor=1, Strength=digit_scroller_6)
list_item = ListItem(
    List=deconstruct_mesh.Vertices,
    Index=[digit_scroller_3, digit_scroller_2, digit_scroller_4, digit_scroller_5],
    Wrap=True)
load = Load(Point=deconstruct_mesh.Vertices, ForceVector=unit_z, Weighting=1)
anchor = Anchor(Point=list_item, Strength=10000)
anchorxyz = AnchorXYZ(Point=deconstruct_mesh.Vertices, X=Toggle(True), Y=Toggle(True), Z=Toggle(False), Strength=1000)
gate_or = GateOr(A=Button(), B=Toggle(True))
gate_not = GateNot(A=gate_or)
bouncysolver = BouncySolver(
    GoalObjects=[load, edgelengths, anchorxyz, anchor],
    Reset=gate_not,
    Threshold=1e-15,
    Tolerance=0.0001,
    Damping=0.99,
    Iterations=10,
    On=gate_or)  # -> I, V, O
line = Line(bouncysolver.O)
surface_from_points = SurfaceFromPoints(Points=bouncysolver.V, UCount=Slider(11, range=0..30), Interpolate=False)
