# Grasshopper definition ElevationSRTM.gh (Grasshopper 1.0.8)
# plug-ins: RhinoCodePluginGH

digit_scroller = DigitScroller(Scroller_Digits=12, Scroller_Prefix="Digit Scroller", Scroller_Radix=9, Scroller_Value=36.368)
digit_scroller_2 = DigitScroller(Scroller_Digits=12, Scroller_Prefix="Digit Scroller", Scroller_Radix=9, Scroller_Value=127.365)
digit_scroller_3 = DigitScroller(Scroller_Digits=12, Scroller_Prefix="Digit Scroller", Scroller_Radix=9, Scroller_Value=2000)
digit_scroller_4 = DigitScroller(Scroller_Digits=12, Scroller_Prefix="Digit Scroller", Scroller_Radix=9, Scroller_Value=10)
elevation_points = Python3Script(lat=digit_scroller, lon=digit_scroller_2, size=digit_scroller_3, step=digit_scroller_4)  # -> out, points, U
# ---------- elevation_points: Python ----------
"""Grasshopper Script"""
# requirements: srtm.py, numpy
import srtm
import numpy as np
import Rhino.Geometry as rg

def linspace(start, end=0, step=1):
    if start > end:
        end = start
        start = 0
    yield start
    while start < end:
        start += step
        yield start

elevation_data = srtm.get_data()

def getElevation(lat, lon):
    elev = elevation_data.get_elevation(lat, lon)
    return elev

_lat = lat if not lat == None else 36.368
_lon = lon if not lon == None else 127.365
_size = size/111000 if not size == None else 0.1
_step = 2*_size / (step if not step == None else 20)

points = []
U = 0
for i in linspace(_lon - _size, _lon + _size, _step):
    U += 1
    for j in linspace(_lat - _size, _lat + _size, _step):
        elev = getElevation(j,i)
        if not elev == None:
            points.append(rg.Point3d((j - _lat)*111000, (i - _lon)*111000, elev))
# ---------- end elevation_points ----------
digit_scroller_5 = DigitScroller(Scroller_Digits=12, Scroller_Prefix="Digit Scroller", Scroller_Radix=9, Scroller_Value=1000)
point = Point(elevation_points.points)
surface_from_points = SurfaceFromPoints(Points=point, UCount=elevation_points.U, Interpolate=False)
divide_surface = DivideSurface(Surface=surface_from_points, UCount="1", VCount="1")  # -> Points, Normals, Parameters
deconstruct = Deconstruct(Point=divide_surface.Points)  # -> XComponent, YComponent, ZComponent
construct = ConstructPoint(XCoordinate=deconstruct.XComponent, YCoordinate=deconstruct.YComponent, ZCoordinate="0")
split_list = SplitList(List=construct, Index="1")  # -> ListA, ListB
explode_tree = ExplodeTree(Data=split_list.ListA)  # -> _00000, _00010
explode_tree_2 = ExplodeTree(Data=split_list.ListB)  # -> _00000, _00010
unit_z = UnitZ(Factor=digit_scroller_5)
_4point_surface = _4PointSurface(CornerA=explode_tree._00000, CornerB=explode_tree._00010, CornerC=explode_tree_2._00010, CornerD=explode_tree_2._00000)
panel = Panel("""30
35
40
45
50
55
60
65
70
75
80
85
90
95
100
105
110
115
120
125
130
135
140
145
150""")
extrude = Extrude(Base=_4point_surface, Direction=unit_z)
split_brep = SplitBrep(Brep=extrude, Cutter=surface_from_points)
cherry_picker = CherryPicker(split_brep, ListIndex=0)
unit_z_2 = UnitZ(Factor=panel)
move = Move(Geometry=_4point_surface, Motion=unit_z_2)  # -> Geometry, Transform
brep_brep = BrepBrep(BrepA=move.Geometry, BrepB=surface_from_points)  # -> Curves, Points
