# Grasshopper definition VoronoiFrame.gh (Grasshopper 1.0.8)

md_slider = MDSlider(SliderMode=0, slider_value=Point(1, 1, 0.5), x_domain=Domain(0, 100), y_domain=Domain(0, 100), z_domain=Domain(0, 1))
digit_scroller = DigitScroller(Scroller_Digits=12, Scroller_Prefix="Digit Scroller", Scroller_Radix=9, Scroller_Value=2)
md_slider_2 = MDSlider(SliderMode=0, slider_value=Point(0, 0, 0.5), x_domain=Domain(0, 1), y_domain=Domain(0, 1), z_domain=Domain(0, 1))
rectangle_2pt = Rectangle2Pt(Plane=PlaneXY(0, 0, 0), PointA=md_slider_2, PointB=md_slider, Radius=0)  # -> Rectangle, Length
box_rectangle = BoxRectangle(Rectangle=rectangle_2pt.Rectangle, Height=Slider(10, range=0..20))
populate_3d = Populate3D(Region=box_rectangle, Count=Slider(100, range=10..100), Seed=Slider(4, range=0..10))
voronoi_3d = Voronoi3D(Points=populate_3d, Box=box_rectangle)  # -> Cells, Boundary
brep_edges = BrepEdges(Brep=voronoi_3d.Cells)  # -> Naked, Interior, NonManifold
pipe = Pipe(Curve=brep_edges.Interior, Radius=Slider(0.5, range=0..1), Caps=digit_scroller)
solid_union = SolidUnion(Breps=pipe)
